# Dynamo graph nodeTest.dyn (Dynamo 1.3.4.6666)

number = DoubleInput(10)
number_2 = DoubleInput(15)
byTwoDoubles = ZeroTouchEssentials.ZeroTouchEssentials.ByTwoDoubles(number, number_2)
returnMultiExample = ZeroTouchEssentials.ZeroTouchEssentials.ReturnMultiExample(number, number_2)
doubleLength = ZeroTouchEssentials.ZeroTouchEssentials.DoubleLength()  # unwired: arg0
A = ZeroTouchEssentials.ZeroTouchEssentials.A()  # unwired: arg0
B = ZeroTouchEssentials.ZeroTouchEssentials.B()  # unwired: arg0
